# Grasshopper definition AgentBodiesVolumetric.gh (Grasshopper 1.0.7)
# Copyright: Co-de-iT
# plug-ins: CurlNoise, FileToScript

cs_file_to_sync = Panel("Align Planes.cs")
cs_file_to_sync_2 = Panel("Planes2Bodies.cs")
dir_type = ValueList({"desktop": 0, "documents": 1, "GH file path": 2, "C:": 3}, selected="GH file path")
f_ghfilepath = GHFilePathInfo()  # -> F, P
# ---------- f_ghfilepath: C# ----------
                                      /*
    froGH - a sparse collection of (in)utilities for Grasshopper

    GH File and Path info

    code by Alessio Erioli

    froGH by Co-de-iT is licensed under a Creative Commons Attribution 4.0 International License.
    http://creativecommons.org/licenses/by/4.0/

    */

    initComp();

    GH_Document ghDoc = Grasshopper.Instances.ActiveCanvas.Document;

    int nameLen = ghDoc.DisplayName.TrimEnd('*').Length + 3; // +3 accounts for the '.gh' extension
    int fileLen = ghDoc.FilePath.TrimEnd('*').Length;

    F = ghDoc.DisplayName.TrimEnd('*');
    P = ghDoc.FilePath.Substring(0, fileLen - nameLen);
# ---------- f_ghfilepath: C# additional code ----------
  void initComp(){

    Component.Name = "GH File Path Info";
    Component.NickName = "f_GHFilePath";
    Component.Description = "Provides info on current Grasshopper Document file name and path\nUseful for exporting files with the same name as the gh file and in the same directory";
    Component.Params.Output[0].Name = "File Name";
    Component.Params.Output[0].Description = "Current GH file name";
    Component.Params.Output[1].Name = "File Path";
    Component.Params.Output[1].Description = "Current GH file path";
  }
# ---------- end f_ghfilepath ----------
f_pathg = PathGenerator(type=dir_type, subDir=f_ghfilepath.F)  # -> dir; inputs type: Int32, subDir: String
# ---------- f_pathg: C# ----------
                           /*
    froGH - a sparse collection of (in)utilities for Grasshopper

    Path Generator
    code by Alessio Erioli - value list generation based on code by James Ramsden

    froGH by Co-de-iT is licensed under a Creative Commons Attribution 4.0 International License.
    http://creativecommons.org/licenses/by/4.0/

    */
    initComp();


    String S = "";
    String root = "";
    String end = "\\";
    String eol = Environment.NewLine;

    // __________________ autoList part __________________

    // variable for the list
    Grasshopper.Kernel.Special.GH_ValueList vList;
    // tries to cast input as list
    try{

      // if the list is not the first parameter then change Input[0] to the corresponding value
      vList = (Grasshopper.Kernel.Special.GH_ValueList) Component.Params.Input[0].Sources[0];
      // Print("value list connected");
      // check if the list must be created
      //if (vList.NickName != "dir type"){
      if (!vList.NickName.Equals("dir type")){
        vList.ClearData();
        vList.ListItems.Clear();
        vList.NickName = "dir type";
        var item1 = new Grasshopper.Kernel.Special.GH_ValueListItem("desktop", "0");
        var item2 = new Grasshopper.Kernel.Special.GH_ValueListItem("documents", "1");
        var item3 = new Grasshopper.Kernel.Special.GH_ValueListItem("GH file path", "2");
        var item4 = new Grasshopper.Kernel.Special.GH_ValueListItem("C:", "3");
        vList.ListItems.Add(item1);
        vList.ListItems.Add(item2);
        vList.ListItems.Add(item3);
        vList.ListItems.Add(item4);

        vList.ListItems[0].Value.CastTo(out type);
      }
    }
    catch{
      // handles anything that is not a value list
    }


    switch(type){
      case 0:
        root = Environment.GetFolderPath(Environment.SpecialFolder.Desktop) + end;
        S = "Desktop";
        break;
      case 1:
        root = Environment.GetFolderPath(Environment.SpecialFolder.MyDocuments) + end;
        S = "Documents";
        break;
      case 2:
        GH_Document ghDoc = owner.OnPingDocument();

        if (ghDoc.IsFilePathDefined)
        {
          int nameLen = ghDoc.DisplayName.TrimEnd('*').Length + 3; // +3 accounts for the '.gh' extension
          int fileLen = ghDoc.FilePath.TrimEnd('*').Length;

          //F = ghDoc.DisplayName.TrimEnd('*');
          root = ghDoc.FilePath.Substring(0, fileLen - nameLen);
          //root = gh_d.FilePath;
          S = "GH File path";
        }
        else
        {
          Print("No path defined. Saving to Desktop until then");
          root = Environment.GetFolderPath(Environment.SpecialFolder.Desktop);
          S = "Desktop";
        }
        break;
      case 3:
        root = "C:" + end;
        S = root + end;
        break;
    }
    dir = root + (subDir != null ? (subDir + end) : "");
    Component.Message = S;
# ---------- f_pathg: C# additional code ----------
  void initComp(){
    Component.Name = "Path Generator";
    Component.NickName = "f_PathG";
    Component.Description = "generates a path based on local direcories such as Desktop, Documents, GH file path";
    Component.Params.Input[0].Name = "dir type";
    Component.Params.Input[0].Description = "directory type: 0 desktop, 1 documents, 2 GH file path, 3 C:\nconnect a value list for automatic list generation";
    Component.Params.Input[1].Name = "custom subdir";
    Component.Params.Input[1].Description = "(optional) custom subdirectory";
  }
# ---------- end f_pathg ----------
concat = Concatenate(FragmentA=f_pathg, FragmentB=cs_file_to_sync)
concat_2 = Concatenate(FragmentA=f_pathg, FragmentB=cs_file_to_sync_2)
# Agent Bodies Volumetric
# 
# Agent Bodies in a 3D volume, interacting with a scalar Simplex Noise and vector Curl Noise fields.
# 
# code by Alessio Erioli
# 
# v 0.2
# 
# © a3 _/TH.esis 2020 _ Creative Commons Attribution-NonCommercial-ShareAlike3.0 UnportedLicense.
path = FilePath(concat)
path_2 = FilePath(concat_2)

# ---- group: volume
box = Box({Plane=Plane(origin=(0, 0, 0), x=(0, 1, 0), y=(1, 0, 0)), X=Domain(0, 10), Y=Domain(0, 10), Z=Domain(-10, 0)})

# ----
n_of_planes = Slider(3000, range=10..5000)
_3d = BooleanToggle(True)

# ---- group: volumetric point grid from Box
c_script = CSharpScript(B=box, nx=Slider(40, range=0..100), ny=Slider(40, range=0..100), nz=Slider(40, range=0..100))  # -> A; inputs B: Brep, nx: Int32, ny: Int32, nz: Int32
# ---------- c_script: C# ----------
    BoundingBox b1 = B.GetBoundingBox(false);

    List<GH_Point> pts = new List<GH_Point>();

    double stepX = 1.0 / (double) nx;
    double stepY = 1.0 / (double) ny;
    double stepZ = 1.0 / (double) nz;

    for (int i = 0; i < nz + 1; i++)
      for (int j = 0; j < ny + 1; j++)
        for (int k = 0; k < nx + 1; k++)
          pts.Add(new GH_Point(b1.PointAt(k * stepX, j * stepY, i * stepZ)));

    A = pts;
# ---------- end c_script ----------

# ----
random_vector = CSharpScript(n=n_of_planes, seed=Slider(0, range=0..100), DDD=_3d)  # -> out, V; inputs n: Int32, seed: Int32, DDD: Boolean
# ---------- random_vector: C# usings ----------
using System.IO;
using System.Linq;
using System.Data;
using System.Drawing;
using System.Reflection;
using System.Windows.Forms;
using System.Xml;
using System.Xml.Linq;
using System.Runtime.InteropServices;

using Rhino.DocObjects;
using Rhino.Collections;
using GH_IO;
using GH_IO.Serialization;
# ---------- random_vector: C# ----------
    if(seed == 0) rnd = new Random(); else rnd = new Random(seed);
    List <GH_Vector> vectors = new List<GH_Vector>();
    Vector3d vec = new Vector3d();
    for (int i = 0; i < n; i++){
      vec.X = rnd.NextDouble() - 0.5;
      vec.Y = rnd.NextDouble() - 0.5;
      vec.Z = DDD ? rnd.NextDouble() - 0.5 : 0;
      vec.Unitize();
      vectors.Add(new GH_Vector(vec));
    }
    V = vectors;
# ---------- random_vector: C# additional code ----------
  Random rnd;
# ---------- end random_vector ----------
pop3d = Populate3D(Region=box, Count=n_of_planes, Seed=1)

# ---- group: curl noise parameters
number_slider = Slider(0.121, range=0..1)
number_slider_2 = Slider(0.6, range=0..1)

# ---- group: simplex noise parameters
number_slider_3 = Slider(0.18, range=0..1)
number_slider_4 = Slider(0, range=0..10)

# ---- group: Simplex noise calculations
c_script_2 = CSharpScript(
    P=c_script,
    scale=number_slider_3,
    time=number_slider_4,
    Reference="C:\Users\Alessio\AppData\Roaming\Grasshopper\Libraries\Noises.dll")  # -> Sn; inputs P: list, scale: Double, time: Double
# ---------- c_script_2: C# usings ----------
using Noises;
using System.Linq;
using System.Threading.Tasks;
# ---------- c_script_2: C# ----------
    float[] NoiseVal = new float[P.Count];
    float fScale = (float) scale;
    float fTime = (float) time;

    Point3d[] pts = P.Select(p => (Point3d) p).ToArray();

    Parallel.For(0, P.Count, i =>
      {
      NoiseVal[i] = Noise.Generate((float) pts[i].X * fScale + fTime, (float) pts[i].Y * fScale + fTime, (float) pts[i].Z * fScale + fTime);
      });

    Sn = NoiseVal;
# ---------- end c_script_2 ----------

# ---- group: isoValue target and range
number_slider_5 = Slider(-0.1, range=-1..1)
number_slider_6 = Slider(0.3, range=0..1)

# ---- group: Symmetric Interval around value
c_script_3 = CSharpScript(val=number_slider_5, tol=number_slider_6)  # -> I; inputs val: Double, tol: Double
# ---------- c_script_3: C# ----------
    I = new Interval(val - tol, val + tol);
# ---------- end c_script_3 ----------

# ----
inc = Includes(Value=c_script_2, Domain=c_script_3)  # -> Includes, Deviation
plane_radius = Slider(0.25, range=0..1)
max_force = Slider(0.4, range=0..1)
display = ValueList({"full grid": 0, "isovalue range": 1}, selected="isovalue range")
reset = Button()
go = Button()
debug = BooleanToggle(False)
pt = Point(pop3d)
vec = Vector(random_vector.V)
cull = CullPattern(List=c_script, CullPattern=inc.Includes)
cull_2 = CullPattern(List=c_script_2, CullPattern=inc.Includes)
trt = TheRealToggle(t=go)  # -> T; inputs t: Boolean
# ---------- trt: C# ----------
    InitComp();

    if(t) r = !r;

    Component.Message = r.ToString();

    T = r;
# ---------- trt: C# additional code ----------
  bool r = false;
  public void InitComp()
  {
    Component.Name = "The Real Toggle";
    Component.NickName = "TRT";
    Component.Description = "Permanent toggle - use a button to change boolean value.\nJust because I hate double clicks.";
  }
# ---------- end trt ----------
filter = StreamFilter(Gate=display, Stream0=c_script, Stream1=cull)
filter_2 = StreamFilter(Gate=display, Stream0=c_script_2, Stream1=cull_2)
multiplication = Multiplication(A=plane_radius, B=Slider(4, range=0..5))

# ---- group: Simplex Noise display
gradient = Gradient(LowerLimit="-1", UpperLimit=1, Parameter=filter_2, stops=[0: RGB(0, 0, 0), 1: RGB(255, 255, 255)])
preview = CustomPreview(Geometry=filter, Material=gradient)  # disabled

# ---- group: orient planes
# P - points
# V - vectors (initial directions)
# 
# cInt - cohesion Intensity
# aInt - alignment Intensity
# sIint - separation Intensity
# fieldInt - vector field Intensity
# isoVInt - scalar isovalue Intensity
c_script_4 = CSharpScript(
    reset=reset,
    go=trt,
    debug=debug,
    P=pt,
    V=vec,
    curlNoiseScale=number_slider,
    curlNoiseTime=number_slider_2,
    simNoiseScale=number_slider_3,
    simNoiseTime=number_slider_4,
    isoValue=number_slider_5,
    isoValueTol=number_slider_6,
    planeRadius=plane_radius,
    searchRadius=multiplication,
    cInt=Slider(0.05, range=0..1),
    aInt=Slider(0.5, range=0..1),
    sInt=Slider(10, range=0..10),
    fieldInt=Slider(0.05, range=0..1),
    isoVInt=Slider(0.5, range=0..1),
    maxForce=max_force,
    Reference="C:\Users\Alessio\AppData\Roaming\Grasshopper\Libraries\Noises.dll")  # -> out, Planes, neigh; inputs reset: Boolean, go: Boolean, debug: Boolean, P: list, V: list, curlNoiseScale: Double, curlNoiseTime: Double, simNoiseScale: Double, simNoiseTime: Double, isoValue: Double, isoValueTol: Double, planeRadius: Double, searchRadius: Double, cInt: Double, aInt: Double, sInt: Double, fieldInt: Double, isoVInt: Double, maxForce: Double
# ---------- c_script_4: C# usings ----------
 

using System.Threading.Tasks;
using System.Collections.Concurrent;
using System.Drawing;
using System.Linq;
using Noises;
# ---------- c_script_4: C# ----------
 

        // align planes with field/neighbours - C#
        // code by Alessio Erioli - (c) Co-de-iT 2019 

        if (P == null || V == null || P.Count != V.Count) return;

        if (reset || aPS == null)
        {
            // Casting P and V to Point3d and Vector3d Lists
            List<Point3d> pList = new List<Point3d>();
            List<Vector3d> vList = new List<Vector3d>();
            for (int i = 0; i < P.Count; i++)
            {
                pList.Add((Point3d)P[i]);
                vList.Add((Vector3d)V[i]);
            }

            // passing the essential parameters to the new simulation
            aPS = new AgentPlaneSimulation(pList, vList);

        }

        if (go)
        {

            // update parameters
            aPS.curlNoiseScale = curlNoiseScale;
            aPS.curlNoiseTime = curlNoiseTime;
            aPS.simplexNoiseScale = (float)simNoiseScale;
            aPS.simplexNoiseTime = (float)simNoiseTime;
            aPS.isoValue = (float)isoValue;
            aPS.isoValueTol = (float)isoValueTol;
            aPS.planeRadius = planeRadius;
            aPS.searchRadius = searchRadius;
            aPS.cohesionIntensity = cInt;
            aPS.alignmentIntensity = aInt;
            aPS.separationIntensity = sInt;
            aPS.fieldIntensity = fieldInt;
            aPS.isoValIntensity = isoVInt;
            aPS.maxForce = maxForce;

            // run simulation
            aPS.Update();
            Component.ExpireSolution(true);
        }

        // extract output geometries
        Planes = aPS.ExtractPlanes();
        if (debug) neigh = aPS.ExtractNeighbours();
# ---------- c_script_4: C# additional code ----------
 

    // ............................................................ global variables 
    // global variables

    public AgentPlaneSimulation aPS;

    // .................................................................... classes 
    // .............................................................................
    // .............................................................................



    // ...................................................... Simulation ..........
    // ............................................................................
    // ............................................................................

    public class AgentPlaneSimulation
    {
        // ..........................    fields

        public double curlNoiseScale;
        public double curlNoiseTime;
        public float simplexNoiseScale;
        public float simplexNoiseTime;
        public float isoValue;
        public float isoValueTol;
        public double planeRadius;
        public double searchRadius;
        public double cohesionIntensity;
        public double alignmentIntensity;
        public double separationIntensity;
        public double fieldIntensity;
        public double isoValIntensity;
        public double maxForce;
        public double sepDistSquared;

        public AgentPlane[] agentPlanes;

        // ..........................    constructor

        public AgentPlaneSimulation(List<Point3d> P, List<Vector3d> V)
        {
            // build agent planes array
            Build(P.ToArray(), V.ToArray());
        }

        // ..........................    methods

        public void Build(Point3d[] P, Vector3d[] V)
        {
            // build agent planes array
            agentPlanes = new AgentPlane[P.Length];

            // populate agent planes array
            Parallel.For(0, P.Length, i =>
            {
                agentPlanes[i] = new AgentPlane(P[i], V[i], this);
            });

        }

        public void Update()
        {
            sepDistSquared = 4 * planeRadius * planeRadius; // the square of 2*plane radius

            // . . . . . . . . . . environmental and stigmergic interactions


            // calculate field influence vector for agents

            Parallel.For(0, agentPlanes.Length, i =>
             {
                 // this resets the acceleration (or desired direction)
                 // in case a different update sequence is implemented
                 // remember to reset desired before calculating the new iteration
                 agentPlanes[i].ResetDesireds();
                 // computes alignment with Curl Noise
                 agentPlanes[i].ComputeCurlNoiseAlign();
                 agentPlanes[i].ComputeDesiredIsoValue();

             });

            // . . . . . . . . . . peer-to-peer interaction
            FlockRTree();

            // . . . . . . . . . . update position and direction
            UpdateAgentsDirection();

        }

        public void FlockRTree()
        {

            // declare RTree
            RTree rTree = new RTree();

            // populate RTree
            for (int i = 0; i < agentPlanes.Length; i++)
                rTree.Insert(agentPlanes[i].O, i);

            // find neighbours for each agent plane
            foreach (AgentPlane agent in agentPlanes)
            {
                agent.neighbours.Clear();

                rTree.Search(new Sphere(agent.O, searchRadius), (sender, args) =>
                {
                    if (agentPlanes[args.Id] != agent)
                        agent.neighbours.Add(agentPlanes[args.Id]);
                });
            }

            // compute desired vector for each agent
            Parallel.ForEach(agentPlanes, agent =>
             {
                 agent.ComputeDesiredNeighbours();
             });

        }

        public void UpdateAgentsDirection()
        {
            // another way of implementing a parallel loop: parallel foreach with partitioner
            var part = Partitioner.Create(0, agentPlanes.Length);
            Parallel.ForEach(part, (range, loopstate) =>
            {
                for (int i = range.Item1; i < range.Item2; i++)
                    agentPlanes[i].Update();
            });
        }


        public GH_Plane[] ExtractPlanes()
        {
            GH_Plane[] gP = new GH_Plane[agentPlanes.Length];
            Parallel.For(0, agentPlanes.Length, i =>
            {
                gP[i] = new GH_Plane(agentPlanes[i].ExtractPlane());
            });
            return gP;
        }

        public DataTree<GH_Point> ExtractNeighbours()
        {
            DataTree<GH_Point> neighPts = new DataTree<GH_Point>();
            for (int i = 0; i < agentPlanes.Length; i++)
                for (int j = 0; j < agentPlanes[i].neighbours.Count; j++)
                    neighPts.Add(new GH_Point(agentPlanes[i].neighbours[j].O), new GH_Path(i));

            return neighPts;
        }

    }


    // ........................................................... Agent ..........
    // ............................................................................
    // ............................................................................
    public class AgentPlane
    {

        // fields
        public Point3d O;
        public Vector3d X, Y;
        public Vector3d desDirX, desDirY; // desired directions - influenced by environmental field and neighbour agents' directions
        public Vector3d desPos; // desired position - influenced by environmental movement constraints (es. surface) and neighbour agents
        public AgentPlaneSimulation agentSim;
        public List<AgentPlane> neighbours;
        public float currentFieldVal;
        // search icosahedron for isovalue detection - common to all AgentPlanes and constant so it is declared static and readonly
        static readonly Vector3d[] SearchIcosahedron = {
            new Vector3d( 0, 0, 1), new Vector3d(0.894427, 0, 0.447214), new Vector3d(0.276393, 0.850651, 0.447214),
            new Vector3d( -0.723607, 0.525731, 0.447214), new Vector3d( -0.723607, -0.525731, 0.447214),
            new Vector3d( 0.276393, -0.850651, 0.447214), new Vector3d( 0.723607, 0.525731, -0.447214),
            new Vector3d( -0.276393, 0.850651, -0.447214), new Vector3d( -0.894427, 0, -0.447214),
            new Vector3d( -0.276393, -0.850651, -0.447214), new Vector3d( 0.723607, -0.525731, -0.447214), new Vector3d( 0, 0, -1)};

        // constructor
        public AgentPlane(Point3d O, Vector3d X, AgentPlaneSimulation agentSim)
        {
            this.O = O;
            X.Unitize();
            this.X = X;
            this.agentSim = agentSim;
            Vector3d oV = new Vector3d(O);
            oV.Unitize();
            Y = Vector3d.CrossProduct(X, oV);
            neighbours = new List<AgentPlane>();
        }
        // methods

        public void Update()
        {
            // update position
            O += desPos * agentSim.maxForce;
            // update X direction
            X = X * (1 - agentSim.maxForce) + agentSim.maxForce * desDirX;
            X.Unitize();
            // update Y direction
            Y = Y * (1 - agentSim.maxForce) + agentSim.maxForce * desDirY;
            Y.Unitize();
        }

        public void ResetDesireds()
        {
            desDirX = Vector3d.Zero;
            desDirY = Vector3d.Zero;
            desPos = Vector3d.Zero;
        }

        public void ComputeDesiredNeighbours()
        {

            // neighbours interaction
            if (neighbours.Count != 0)
            {
                // define flocking vectors
                Vector3d alignX = Vector3d.Zero;
                Vector3d alignY = Vector3d.Zero;
                Vector3d cohesion = Vector3d.Zero;
                Vector3d separation = Vector3d.Zero;
                Vector3d pointer;

                int sepCount = 0;
                double distanceSquared;
                double invNCount = 1.0 / neighbours.Count;

                // neighbours calculations
                foreach (AgentPlane neighbour in neighbours)
                {
                    alignX += neighbour.X;
                    alignY += neighbour.Y;
                    pointer = neighbour.O - O;
                    cohesion += pointer;
                    distanceSquared = O.DistanceToSquared(neighbour.O);
                    if (distanceSquared < agentSim.sepDistSquared)
                    {
                        // separation vector is bigger when closer to another agent
                        separation += -pointer * (agentSim.sepDistSquared - distanceSquared);
                        sepCount++;
                    }
                }

                // ............................ alignment behavior
                alignX *= invNCount;
                alignY *= invNCount;

                // updates desired direction
                // multiplies alignment vector by alignment intensity factor
                desDirX += agentSim.alignmentIntensity * alignX;
                desDirY += agentSim.alignmentIntensity * alignY;

                // ............................ cohesion behavior
                cohesion *= invNCount;

                // updates desired position
                // multiplies cohesion vector by cohesion intensity factor
                desPos += agentSim.cohesionIntensity * cohesion;


                // ............................ separation behavior
                if (sepCount > 0)
                    separation /= sepCount;

                // updates desired position
                // multiplies separation vector by separation intensity factor
                desPos += agentSim.separationIntensity * separation;

            }

        }

        public void ComputeDesiredIsoValue()
        {
            float fieldVal, diff, minDiff; // prepare variables

            currentFieldVal = Noise.Generate((float)(O.X * agentSim.simplexNoiseScale + agentSim.simplexNoiseTime),
                (float)(O.Y * agentSim.simplexNoiseScale + agentSim.simplexNoiseTime),
                (float)(O.Z * agentSim.simplexNoiseScale + agentSim.simplexNoiseTime));// field value at current positions

            minDiff = Math.Abs(currentFieldVal - agentSim.isoValue); // update current distance from iso value

            Point3d target = O;// if no value is within the difference range, the target is the current position

            if (minDiff > agentSim.isoValueTol)
            {
                for (int i = 0; i < SearchIcosahedron.Length; i++)
                {
                    Point3f sample = (Point3f)(O + SearchIcosahedron[i] * agentSim.planeRadius);
                    fieldVal = Noise.Generate(sample.X * agentSim.simplexNoiseScale + agentSim.simplexNoiseTime,
                        sample.Y * agentSim.simplexNoiseScale + agentSim.simplexNoiseTime,
                        sample.Z * agentSim.simplexNoiseScale + agentSim.simplexNoiseTime);
                    diff = Math.Abs(fieldVal - agentSim.isoValue);
                    if (diff < minDiff)
                    {
                        minDiff = diff;
                        target = sample;
                    }
                }
            }

            desPos += (target - O) * agentSim.isoValIntensity;
        }

        public void ComputeCurlNoiseAlign()
        {
            // curl noise vector
            Vector3d curlNoiseVector;
            curlNoiseVector = CurlNoise.CurlNoiseVector(O, agentSim.curlNoiseScale, agentSim.curlNoiseTime, true);
            curlNoiseVector.Unitize();
            ComputeFieldAlign(curlNoiseVector);
        }

        /// <summary>
        /// This is a more generic function to allow the agent plane system to interact with more than one vector field.
        /// </summary>
        /// <param name="fieldVector">The Vector the agent interacts with</param>
        public void ComputeFieldAlign(Vector3d fieldVector)
        {
            desDirX += fieldVector * agentSim.fieldIntensity;
        }


        public Plane ExtractPlane()
        {
            //Vector3d oV = new Vector3d(O);
            //oV.Unitize();
            //Y = Vector3d.CrossProduct(X, oV);
            return new Plane(O, X, Y);
        }

    }

    // .................................................................. Utilities 
    #region Utilities

    public float Remap(float val, float from1, float to1, float from2, float to2)
    {
        return (val - from1) / (to1 - from1) * (to2 - from2) + from2;
    }

    public GH_Colour Vec2Col(Vector3d v)
    {
        v.Unitize();
        int red = (int)Math.Floor(Remap((float)v.X, -1f, 1f, 0f, 255f));
        int green = (int)Math.Floor(Remap((float)v.Y, -1f, 1f, 0f, 255f));
        int blue = (int)Math.Floor(Remap((float)v.Z, -1f, 1f, 0f, 255f));
        return new GH_Colour(Color.FromArgb(red, green, blue));
    }

    public static Vector3d VectorAmp(Vector3d v, double Amplitude)
    {
        v.Unitize();
        return (v * Amplitude);
    }

    public static Vector3d RandomVector(int seed)
    {
        Vector3d r = Vector3d.Zero;
        Random rnd = new Random(seed);
        r = new Vector3d((rnd.NextDouble() * 2) - 1, (rnd.NextDouble() * 2) - 1, (rnd.NextDouble() * 2) - 1);
        return r;
    }

    public static Vector3d[] RandomVectors(int length)
    {
        Vector3d[] randomVectors = new Vector3d[length];
        Parallel.For(0, length, i =>
        {
            randomVectors[i] = RandomVector(i);
        });

        return randomVectors;
    }
    #endregion
# ---------- end c_script_4 ----------

# ---- group: Curl noise display
number_slider_7 = Slider(0.25, range=0..1)  # disabled
panel = Panel("true")  # disabled
curl = CurlNoise(Points=filter, Scale=number_slider, Offset=number_slider_2, _3D=panel)  # -> CurlVector, Colour; disabled
amp = Amplitude(Vector=curl.CurlVector, Amplitude=number_slider_7)  # disabled
panel_2 = Panel("1")  # disabled
vdisex = VectorDisplayEx(Point=filter, Vector=amp, Colour=curl.Colour, Width=panel_2)  # disabled

# ----
number_slider_8 = Slider(10, range=5..10)
ftsv2 = FileToScriptV2(File=path)
generic_messages = Panel(c_script_4.out)
msphere = MeshSphere(Base=c_script_4.Planes, Radius=plane_radius, UCount=number_slider_8, VCount=number_slider_8)  # disabled
deplane = DeconstructPlane(Plane=c_script_4.Planes)  # -> Origin, XAxis, YAxis, ZAxis
mjoin = MeshJoin(Meshes=msphere)  # disabled

# ---- group: debug display
filter_3 = StreamFilter(Gate=debug, Stream1=c_script_4.neigh)  # disabled
pt_2 = Point(filter_3)  # disabled
ln = Line(StartPoint=graft(c_script_4.Planes), EndPoint=pt_2)  # -> simplify(Line); disabled
panel_3 = Panel("0")  # disabled
branch = TreeBranch(Tree=ln, Path=panel_3, MaintainPaths=True)  # disabled
item = ListItem(List=c_script_4.Planes, Index=panel_3, Wrap=True)  # disabled
cir = Circle(Plane=item, Radius=multiplication)  # disabled

# ----
amp_2 = Amplitude(Vector=deplane.XAxis, Amplitude=Slider(0.25, range=0..1))

# ---- group: Preview Planes
swatch = ColourSwatch(SwatchColor=RGB(255, 255, 255))
cluster = Cluster(plane=c_script_4.Planes, plane_radius=plane_radius)
preview_2 = CustomPreview(Geometry=cluster, Material=swatch)

# ----
preview_3 = CustomPreview(Geometry=mjoin, Material=swatch)  # disabled
vdisex_2 = VectorDisplayEx(Point=deplane.Origin, Vector=amp_2, Colour=deplane.XAxis, Width="1")
number_slider_9 = Slider(10, range=5..10)  # disabled
msphere_2 = MeshSphere(Base=item, Radius=multiplication, UCount=number_slider_9, VCount=number_slider_9)  # disabled
dam = DataDam(DataA=c_script_4.Planes, BufferDelay=10000000, BufferMode=0)

# ---- group: select bodies sample
pt_3 = Point(Point(5.494212895, 4.994374032, 4.204044476))
ptssph = PointsInSphere(P=pt_3, C=dam, r=Slider(3.5, range=0..10))  # -> CP, Ci; inputs P: Point3d, C: list of Point3d, r: Double
# ---------- ptssph: C# ----------
    if (C == null || C.Count == 0) return;

    pts = C;
    cl.Clear();
    ci.Clear();

    // declare RTree
    RTree tree = new RTree();

    // populate it
    for(int i = 0; i < C.Count; i++)
      tree.Insert(C[i], i);

    // perform search

    // option 1.1: EventHandler declared on the fly
    EventHandler<RTreeEventArgs> rTreeCallback = (object sender, RTreeEventArgs e) =>
      {
      cl.Add(pts[e.Id]);
      ci.Add(e.Id);
      };
    // option 1.1 & 1.2: call to external function
    tree.Search(new Sphere(P, r), rTreeCallback);

    //    option 2: use embedded anonymous function with lambda syntax
    //    tree.Search(new Sphere(P0, radius), (object sender, RTreeEventArgs e) =>
    //      {
    //      cl.Add(pts[e.Id]);
    //      ci.Add(e.Id);
    //      });

    CP = cl;
    Ci = ci;
# ---------- ptssph: C# additional code ----------
  List<Point3d> cl = new List<Point3d>();
  List<int> ci = new List<int>();
  List<Point3d> pts = new List<Point3d>();


  // option 1.2: declare callback function as an external one
  //  private void rTreeCallback(object sender, RTreeEventArgs e){
  //    cl.Add(pts[e.Id]);
  //    ci.Add(e.Id);
  //  }
# ---------- end ptssph ----------
item_2 = ListItem(List=dam, Index=ptssph.Ci, Wrap=True)

# ----
list = ValueList({"all bodies": 0, "selection": 1}, selected="selection")
filter_4 = StreamFilter(Gate=list, Stream0=dam, Stream1=item_2)
scale_factor = Slider(1.5, range=0..3)

# ---- group: body type B
crv = Curve([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])

# ----
pln = Plane(filter_4)

# ---- group: body type A
crv_2 = Curve([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])

# ---- group: body type C
crv_3 = Curve([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])

# ----
reset_2 = Button()
go_2 = BooleanToggle(False)
debug_2 = BooleanToggle(True)
number_slider_10 = Slider(1.5, range=0..5)
scale = Scale(Geometry=crv_2, Center=Point(0, 0, 0), Factor=scale_factor)  # -> Geometry, Transform
cir_2 = Circle(Plane=PlaneXY(0, 0, 0), Radius=number_slider_10)
orient = Orient(Geometry=scale.Geometry, Source=PlaneXY(0, 0, 0), Target=graft(pln))  # -> Geometry, Transform

# ---- group: search radius
crv_4 = Curve(cir_2)

# ---- group: agent bodies
# legend: sR - agent search radius
# body - body shape (see instructions)
c_script_5 = CSharpScript(reset=reset_2, go=go_2, debug=debug_2, steps=Slider(10, range=1..20), Pl=pln, sR=number_slider_10, body=scale.Geometry)  # -> out, iter, Bodies, TipPoints; inputs reset: Boolean, go: Boolean, debug: Boolean, steps: Int32, Pl: list, sR: Double, body: list of Polyline
# ---------- c_script_5: C# usings ----------
 
using System.Threading.Tasks;
using System.Collections.Concurrent;
using System.Linq;
# ---------- c_script_5: C# ----------
 

        /*
          agent bodies interaction - C#
          code by Alessio Erioli - (c) Co-de-iT 2019
          rev. 2 - 2020
        */

        // . . . . . . . . . . . . . . . . . . . . . . . . return on null data
        if (Pl == null || body == null) return;

        // variables for data extraction
        DataTree<Polyline> outBodies = new DataTree<Polyline>();


        // . . . . . . . . . . . . . . . . . . . . . . . . initialize system
        if (reset || aBS == null)
        {
            // cast input into Planes list
            List<Plane> plList = Pl.Select(p => (Plane)p).ToList();

            aBS = new AgentBodySystem(plList, body, sR);
            iterationsCount = 0;
        }


        if (go)
        {
            for (int i = 0; i < steps; i++)
            {
                // update System
                aBS.Update();

                // update iteration counter
                iterationsCount++;
            }
            Component.ExpireSolution(true);
        }


        // . . . . . . . . . . . . . . . . . . . . . . . . extract geometries and data

        // unfortunately, DataTree structures do not work with parallel writing
        // body output must be done in a sequential fashion
        for (int i = 0; i < aBS.Agents.Length; i++)
            outBodies.AddRange(aBS.Agents[i].ExtractBody(), new GH_Path(i));

        iter = iterationsCount;
        Bodies = outBodies;

        if (debug)
        {
            // ConcurrentBag is a thread-safe collection that admits parallel writing
            // but the order is scrambled (in this case order doesn't matter)
            ConcurrentBag<GH_Point> tPoints = new ConcurrentBag<GH_Point>();

            Parallel.For(0, aBS.Agents.Length, i =>
            {
                for (int j = 0; j < aBS.Agents[i].body.Tips.Count; j++)
                    tPoints.Add(new GH_Point(aBS.Agents[i].body.Tips[j].pos));
            });

            TipPoints = tPoints;
        }
# ---------- c_script_5: C# additional code ----------
 

    // global variables
    public AgentBodySystem aBS;
    public int iterationsCount;

    // .................................................................... classes 
    // .............................................................................
    // .............................................................................

    // ...................................................... Simulation ..........
    // ............................................................................
    // ............................................................................
    public class AgentBodySystem
    {
        public AgentBody[] Agents;
        readonly RTree agentsRTree;
        public double searchRadius;
        public double globalDeviation;
        public double deviationThreshold;

        public AgentBodySystem(List<Plane> Pl, List<Polyline> body, double searchRadius)
        {
            Agents = new AgentBody[Pl.Count];
            agentsRTree = new RTree();
            this.searchRadius = searchRadius;
            deviationThreshold = 0.01; // for future implementation (stop when global deviation under this threshold)

            // . . . . . . . . . . . . . . . . . . . . . . . . build agents array & RTree
            // since agents are fixed it can be built in advance
            for (int i = 0; i < Pl.Count; i++)
            {
                Agents[i] = new AgentBody(Pl[i], body);
                agentsRTree.Insert(Agents[i].agentPlane.Origin, i);
            }

            // . . . . . . . . . . . . . . . . . . . . . . . . . . . build neighbours map
            FindNeighbours();
            foreach (AgentBody ab in Agents)
                ab.FindTipNeighbour();
        }

        public void Update()
        {
            globalDeviation = 0.0; // for future implementation

            Parallel.ForEach(Agents, ab =>
            {
                ab.Update();
            });

            // call tips UpdatePosition and UpdateDirection
            Parallel.ForEach(Agents, ab =>
            {
                foreach (Tip t in ab.body.Tips) t.Update();
            });
        }

        void FindNeighbours()
        {
            foreach (AgentBody ab in Agents)
                agentsRTree.Search(new Sphere(ab.body.O, searchRadius), (sender, args) =>
                {
                    if (Agents[args.Id] != ab) ab.Neighbours.Add(Agents[args.Id]);
                });
        }
    }

    // ...................................................... Agent Body ..........
    // ............................................................................
    // ............................................................................

    public class AgentBody
    {
        public Plane agentPlane;
        public Body body;
        public List<AgentBody> Neighbours;
        public AgentBodySystem ABS;

        public AgentBody(Plane agentPlane, List<Polyline> polylines)
        {
            // define agent body and orient it
            this.agentPlane = agentPlane;
            body = new Body(polylines);
            body.Orient(Plane.WorldXY, this.agentPlane);

            Neighbours = new List<AgentBody>(); // this list will be filled later by the FindNeighbours function in AgentBodySystem
        }

        public void Update()
        {
            TipsCohesion();
        }

        public void FindTipNeighbour()
        {
            /*
             each tip finds it own designed neighbour. A neighbour AgentPlane's Tip is a candidate neighbour if:
             . neighbour's tip is within the angle of vision 
             (angle between the current tip dir and the vector connecting the tip with the nighbour's tip
             is within the angle of vision)
             OR
             . neighbour's direction is within the angle of vision
             (angle between the tip direction and the reverse of the nighbour's tip direction is within the angle of vision)

            check which angle is smaller, calculate the distance from the tip to the neighbour's tip or prev respectively
            and select the candidate closer to the tip (find candidate with minimum distance)

             */

            double dSqPos, dSqPrev;
            double anglePos, angleDir;
            double minD;
            foreach (Tip tip in body.Tips)
            {
                minD = double.MaxValue; // 1.0 - max Search Radius (squared)
                foreach (AgentBody nearAg in Neighbours)
                {
                    foreach (Tip neighTip in nearAg.body.Tips)
                    {
                        // calculate angles
                        anglePos = Vector3d.VectorAngle(tip.dir, neighTip.pos - tip.pos);
                        angleDir = Vector3d.VectorAngle(tip.dir, neighTip.prev - tip.pos);

                        if (anglePos < angleDir && anglePos < tip.angleOfVis)
                        {
                            dSqPos = tip.pos.DistanceToSquared(neighTip.pos);
                            if (dSqPos < minD)
                            {
                                minD = dSqPos;
                                tip.neighbour = neighTip;
                            }
                        }
                        else if (angleDir < tip.angleOfVis)
                        {
                            dSqPrev = tip.pos.DistanceToSquared(neighTip.prev);
                            if (dSqPrev < minD)
                            {
                                minD = dSqPrev;
                                tip.neighbour = neighTip;
                            }
                        }
                    }
                }
            }


        }

        public void TipsCohesion()
        {
            foreach (Tip t in body.Tips) t.ComputeDesiredToFixed();
        }

        public List<Polyline> ExtractBody()
        {
            body.Rebuild();
            return body.Arms;
        }

    }

    // ............................................................ Body ..........
    // ............................................................................
    // ............................................................................
    public class Body
    {
        public List<Polyline> Arms;
        public List<Tip> Tips;
        public Point3d O;
        public Body(List<Polyline> polylines)
        {
            /*
             ATTENTION - data type vs reference type copy - or - shallow vs deep copies

             structures (such as Point3d, Vector3d) are passed BY DATA, so, in this case:
             Point3d newPoint = new Point3d(OldPoint);
             newPoint is a true (deep) copy of OldPoint

             classes (all Geometry types, such as Polylines, Curves, Surfaces, BReps) are
             passed BY REFERENCE, so, in this case:
             List<Polyline> Arms = new List<Polyline>(polylines);
             Arms is a SHALLOW copy, so it references always the same PolyLine list.
             This means that any change in the PolyLines in Arms is passed also to the original list,
             since references aren't true copies but just pointers to another object. Any change to a
             reference propagates to the original and all other references.
              
             in order to make a deep copy look for a Duplicate() or Copy() method;
             it may be the case sometimes that one has to write a custom method to ensure copy
            */

            // this makes a deep copy - CORRECT
            Arms = new List<Polyline>();
            foreach (Polyline p in polylines)
                Arms.Add(p.Duplicate());

            O = Arms[0][0];

            Tips = new List<Tip>();
            Point3d prev;
            int armIndex = 0;
            foreach (Polyline arm in Arms)
            {
                if (arm.Count < 3) prev = O; else prev = arm[arm.Count - 2];
                Tips.Add(new Tip(this, arm[arm.Count - 1], prev, armIndex));
            }
        }

        public void Orient(Plane oldPlane, Plane newPlane)
        {
            var x = Transform.PlaneToPlane(oldPlane, newPlane);

            O.Transform(x);

            for (int i = 0; i < Arms.Count; i++)
            {
                Arms[i].Transform(x);
                Tips[i].pos = Arms[i][Arms[i].Count - 1];
                Tips[i].prev = Arms[i][Arms[i].Count - 2];
                Tips[i].dir = Tips[i].pos - Tips[i].prev;
            }

        }

        public void Rebuild()
        {
            for (int i = 0; i < Arms.Count; i++)
                Arms[i][Arms[i].Count - 1] = Tips[i].pos;
        }
    }

    // ............................................................. Tip ..........
    // ............................................................................
    // ............................................................................
    public class Tip
    {
        public Body body;
        public Point3d pos;
        public Point3d prev;
        public Vector3d dir;
        public Vector3d desired;
        public Tip neighbour;
        public int armIndex;
        public double maxLen;
        public double cR;
        public double cI;
        public double angleOfVis;

        public Tip(Body body, Point3d pos, Point3d prev, int armIndex, double cR, double cI, double angleOfVis)
        {
            this.body = body;
            this.pos = pos;
            this.prev = prev;
            this.armIndex = armIndex;
            dir = pos - prev;
            maxLen = dir.Length * 2.0;
            this.cR = cR;
            this.cI = cI;
            this.angleOfVis = angleOfVis;
            desired = Vector3d.Zero;
        }

        // constructor chaining example                                                                  cR     cI     angleOfVis
        public Tip(Body body, Point3d pos, Point3d prev, int armIndex) : this(body, pos, prev, armIndex, 1.0f, 0.05f, Math.PI * 0.3) { }


        public void ComputeDesiredToFixed()
        {
            // reset desired vector
            desired = Vector3d.Zero;
            // if neighbour tips list is zero or null return
            if (neighbour == null) return;

            desired = neighbour.prev - pos;

        }

        public void Update()
        {
            UpdatePosition();
            UpdateDirection();
        }

        public void UpdatePosition()
        {
            pos += desired * cI;
            // limit tip position to a max reach
            Vector3d toTip = pos - prev;
            if (toTip.Length > maxLen)
            {
                toTip = Limit(toTip, maxLen);
                pos = prev + toTip;
            }
        }

        public void UpdateDirection()
        {
            dir = pos - prev;
        }

    }

    // .................................................................. Utilities 
    // .............................................................................

    public static Vector3d Limit(Vector3d v, double length)
    {
        Vector3d rv = new Vector3d(v);
        double len = rv.Length;
        if (len > length)
        {
            rv.Unitize();
            rv *= length;
        }
        return rv;
    }
# ---------- end c_script_5 ----------

# ----
ftsv2_2 = FileToScriptV2(File=path_2)

# ---- group: initial orientation
crv_5 = Curve(orient.Geometry)

# ----
# tip
# prev
# O
iterations = Panel(c_script_5.iter)
end = EndPoints(Curve=c_script_5.Bodies)  # -> Start, End
end_2 = EndPoints(Curve=crv_5)  # -> Start, End

# ---- group: show tips deviation
ln_2 = Line(StartPoint=end_2.End, EndPoint=end.End)
vdisex_3 = VectorDisplayEx(Point=end_2.End, Vector=ln_2, Colour=ColourSwatch(SwatchColor=RGB(255, 255, 255)), Width="1")

# ---- group: copy, internalize and use for Dendro Post processing
# output geometries
crv_6 = Curve(c_script_5.Bodies)

# ----
pt_4 = Point(c_script_5.TipPoints)

curl_2 = CurlNoise(Points=c_script_4.Planes, Scale=number_slider, Offset=number_slider_2, _3D="true")  # -> CurlVector, Colour; disabled

# ---- group: curl noise for comparison
vec_2 = Vector(curl_2.CurlVector)  # disabled

# ----
angle = Angle(VectorA=deplane.XAxis, VectorB=vec_2)  # -> Angle, Reflex; disabled

# ---- group: alignment check
alignment_control = QuickGraph(angle.Angle, SortOrder=0)  # disabled

# ----
unit = UnitVector(Vector=vec_2)  # disabled
amp_3 = Amplitude(Vector=vec_2, Amplitude=Slider(0.25, range=0..1))  # disabled
vdisex_4 = VectorDisplayEx(Point=deplane.Origin, Vector=amp_3, Colour=unit, Width="1")  # disabled

# ==== cluster Cluster
plane_radius = ClusterInput()
plane = ClusterInput()

# ---- group: create a mesh quad face
panel = Panel("""{-1,-1,0}
{1,-1,0}
{1,1,0}
{-1,1,0}""")
conmesh = ConstructMesh(Vertices=panel, Faces={A=0, B=1, C=2, D=3})
scale = Scale(Geometry=conmesh, Center=Point(0, 0, 0), Factor=plane_radius)  # -> Geometry, Transform

# ----
orient = Orient(Geometry=scale.Geometry, Source=PlaneXY(0, 0, 0), Target=plane)  # -> Geometry, Transform
mesh_plane = ClusterOutput(orient.Geometry)
